# Dynamo graph Civil3D_PlaceBlocksAlongAlignment.dyn (Dynamo 2.5.2.7915)
# packages: Civil3DToolkit 1.1.30

# group: INPUT
file_path = Filename("..\..\Sinalização\SINAL.xlsx")  # graph input
alignments = AlignmentNamesDropDown("PB_IP3_T2")  # graph input
dimensão_puxada = DoubleInput(10)  # graph input

# group: DATA
file_from_path = FileObject(path=file_path)
code_block = CodeBlock { "CIVIL-DYNAMO"; false; }
importExcel = Data.ImportExcel(file=file_from_path, sheetName=code_block.out0, showExcel=code_block.out1)
code_block_2 = CodeBlock { 0; }
removeItemAtIndex = List.RemoveItemAtIndex(list=importExcel, indices=code_block_2)
transpose = List.Transpose(lists=removeItemAtIndex)
code_block_3 = CodeBlock(a=transpose)
# ---------- code_block_3.designscript (38 lines) ----------
//KM;
a[0];

//OFFSET;
a[1];

//ROTAÇÃO POSTE;
a[2];

//BLOCO POSTE;
a[3];

//ROTAÇÃO PUXADA;
a[4];

//BLOCO SINAL1;
a[5];

//ROTAÇÃO SINAL1;
a[6];

//BLOCO SINAL 2;
a[7];

//ROTAÇÃO SINAL 2;
a[8];

//BLOCO POSTE
a[9];

//ROTAÇÃO POSTE
a[10];

//DIST AUX 2
a[11];

//DIST AUX 3
a[12];
# ----------------------------------------

# group: BLOCO POSTE (PLANTA)
current = Autodesk.AutoCAD.DynamoNodes.Document.Current()
blockByName = Autodesk.AutoCAD.DynamoNodes.Document.BlockByName(document=current, name=code_block_3.out3)
coordinateSystemByStationOffset = Autodesk.Civil.DynamoNodes.Alignment.CoordinateSystemByStationOffset(alignment=alignments, station=code_block_3.out0, offset=code_block_3.out1, lacing=Longest)
origin = CoordinateSystem.Origin(coordinateSystem=coordinateSystemByStationOffset)
ZAxis = CoordinateSystem.ZAxis(coordinateSystem=coordinateSystemByStationOffset)
rotate = CoordinateSystem.Rotate(coordinateSystem=coordinateSystemByStationOffset, origin=origin, axis=ZAxis, degrees=code_block_3.out2)
modelSpace = Autodesk.AutoCAD.DynamoNodes.Document.ModelSpace(document=current)
byCoordinateSystem = Autodesk.AutoCAD.DynamoNodes.BlockReferenceExtensions.ByCoordinateSystem(source=blockByName, location=rotate, block=modelSpace)

# group: PUXADA
XAxis = Vector.XAxis()
ZAxis_2 = Vector.ZAxis()
rotate_2 = Vector.Rotate(vector=XAxis, axis=ZAxis_2, degrees=code_block_3.out4, lacing=Longest)
byStartPointDirectionLength = Line.ByStartPointDirectionLength(startPoint=origin, direction=rotate_2, length=dimensão_puxada)
code_block_4 = CodeBlock { "SV_LIN_CHAM"; }
current_2 = Autodesk.AutoCAD.DynamoNodes.Document.Current()
modelSpace_2 = Autodesk.AutoCAD.DynamoNodes.Document.ModelSpace(document=current_2)
byGeometry = Autodesk.AutoCAD.DynamoNodes.Object.ByGeometry(geometry=byStartPointDirectionLength, layer=code_block_4, block=modelSpace_2)

# group: SINAL 1
current_3 = Autodesk.AutoCAD.DynamoNodes.Document.Current()
blockByName_2 = Autodesk.AutoCAD.DynamoNodes.Document.BlockByName(document=current_3, name=code_block_3.out5)
endPoint = Curve.EndPoint(curve=byStartPointDirectionLength)
X = Point.X(point=endPoint)
Y = Point.Y(point=endPoint)
byOrigin = CoordinateSystem.ByOrigin(x=X, y=Y)
origin_2 = CoordinateSystem.Origin(coordinateSystem=byOrigin)
ZAxis_3 = CoordinateSystem.ZAxis(coordinateSystem=byOrigin)
rotate_3 = CoordinateSystem.Rotate(coordinateSystem=byOrigin, origin=origin_2, axis=ZAxis_3, degrees=code_block_3.out6)
current_4 = Autodesk.AutoCAD.DynamoNodes.Document.Current()
modelSpace_3 = Autodesk.AutoCAD.DynamoNodes.Document.ModelSpace(document=current_4)
byCoordinateSystem_2 = Autodesk.AutoCAD.DynamoNodes.BlockReferenceExtensions.ByCoordinateSystem(source=blockByName_2, location=rotate_3, block=modelSpace_3)

# group: SINAL 2
XAxis_2 = Vector.XAxis()
ZAxis_4 = Vector.ZAxis()
code_block_5 = CodeBlock { 90; }
sub = code_block_3.out8 - code_block_5
rotate_4 = Vector.Rotate(vector=XAxis_2, axis=ZAxis_4, degrees=sub)
byStartPointDirectionLength_2 = Line.ByStartPointDirectionLength(startPoint=endPoint, direction=rotate_4, length=code_block_3.out11)
endPoint_2 = Curve.EndPoint(curve=byStartPointDirectionLength_2)
current_5 = Autodesk.AutoCAD.DynamoNodes.Document.Current()
blockByName_3 = Autodesk.AutoCAD.DynamoNodes.Document.BlockByName(document=current_5, name=code_block_3.out7)
X_2 = Point.X(point=endPoint_2)
Y_2 = Point.Y(point=endPoint_2)
byOrigin_2 = CoordinateSystem.ByOrigin(x=X_2, y=Y_2)
origin_3 = CoordinateSystem.Origin(coordinateSystem=byOrigin_2)
ZAxis_5 = CoordinateSystem.ZAxis(coordinateSystem=byOrigin_2)
rotate_5 = CoordinateSystem.Rotate(coordinateSystem=byOrigin_2, origin=origin_3, axis=ZAxis_5, degrees=code_block_3.out8)
current_6 = Autodesk.AutoCAD.DynamoNodes.Document.Current()
modelSpace_4 = Autodesk.AutoCAD.DynamoNodes.Document.ModelSpace(document=current_6)
byCoordinateSystem_3 = Autodesk.AutoCAD.DynamoNodes.BlockReferenceExtensions.ByCoordinateSystem(source=blockByName_3, location=rotate_5, block=modelSpace_4)

# group: POSTE
current_7 = Autodesk.AutoCAD.DynamoNodes.Document.Current()
blockByName_4 = Autodesk.AutoCAD.DynamoNodes.Document.BlockByName(document=current_7, name=code_block_3.out9)
XAxis_3 = Vector.XAxis()
ZAxis_6 = Vector.ZAxis()
code_block_6 = CodeBlock { 90; }
sub_2 = code_block_3.out6 - code_block_6
rotate_6 = Vector.Rotate(vector=XAxis_3, axis=ZAxis_6, degrees=sub_2)
byStartPointDirectionLength_3 = Line.ByStartPointDirectionLength(startPoint=endPoint_2, direction=rotate_6, length=code_block_3.out12)
endPoint_3 = Curve.EndPoint(curve=byStartPointDirectionLength_3)
X_3 = Point.X(point=endPoint_3)
Y_3 = Point.Y(point=endPoint_3)
byOrigin_3 = CoordinateSystem.ByOrigin(x=X_3, y=Y_3)
origin_4 = CoordinateSystem.Origin(coordinateSystem=byOrigin_3)
ZAxis_7 = CoordinateSystem.ZAxis(coordinateSystem=byOrigin_3)
rotate_7 = CoordinateSystem.Rotate(coordinateSystem=byOrigin_3, origin=origin_4, axis=ZAxis_7, degrees=code_block_3.out10)
current_8 = Autodesk.AutoCAD.DynamoNodes.Document.Current()
modelSpace_5 = Autodesk.AutoCAD.DynamoNodes.Document.ModelSpace(document=current_8)
byCoordinateSystem_4 = Autodesk.AutoCAD.DynamoNodes.BlockReferenceExtensions.ByCoordinateSystem(source=blockByName_4, location=rotate_7, block=modelSpace_5)

code_block_7 = CodeBlock {  }
